# Grasshopper definition 勾配屋根か受持ち屋根かの判定.gh (Grasshopper 1.0.7)

brep = Brep([<brep referenced from the Rhino model> x7])
python = GhPythonScript(geo=brep, angle=Slider(61, range=0..90))  # -> charge_roof, slope_roof, non_roof; inputs geo: list of Brep
# ---------- python: Python ----------
import rhinoscriptsyntax as rs
import Rhino.Geometry as rg
import math

face_list = []
for i in geo:
    face = i.Faces
    for k in face:
        face_list.append(k)

face_dir_line = []

normal_vec = []
charge_roof = []
slope_roof = []
non_roof = []
judge_angle = math.cos(math.radians(180 - angle))

for j in face_list:
    normal = rg.Surface.NormalAt(j, 0.5, 0.5)
    normal_vec.append(normal)
    z = round(normal[2], 1) + 0.0
    if z == 1:
        charge_roof.append(j)
    elif z < judge_angle:
        non_roof.append(j)
    else:
        slope_roof.append(j)
# ---------- end python ----------
preview = CustomPreview(Geometry=python.charge_roof, Material=ColourSwatch(SwatchColor=RGB(0, 255, 229)))
preview_2 = CustomPreview(Geometry=python.slope_roof, Material=ColourSwatch(SwatchColor=RGB(43, 117, 22)))
preview_3 = CustomPreview(Geometry=python.non_roof, Material=ColourSwatch(SwatchColor=RGB(255, 0, 0)))
