# Grasshopper definition 完成.gh (Grasshopper 1.0.8)

list = ValueList({"60度": 60, "45度": 45}, selected="60度")
srf = Surface([<surface referenced from the Rhino model> x19])
降水量 = Panel("35")
dam = DataDam(DataA=srf, BufferDelay=10000000, BufferMode=0)
custom_mesh_settings = SettingsCustom(
    StitchSeams=True,
    SimplePlanes=False,
    Refine=True,
    MinCount=16,
    MaxCount=400,
    AspectRatio=20,
    MaxDistance=0,
    MaxAngle=20,
    MinEdge="4800",
    MaxEdge="4800")
Z = UnitZ(Factor=1)
rev = Reverse(Vector=Z)

subtraction = Subtraction(A="180", B=list)
edges = BrepEdges(Brep=dam)  # -> Naked, Interior, NonManifold
rad = Radians(Degrees=subtraction)
join = JoinCurves(Curves=edges.Naked, Preserve=False)
area = Area(Geometry=dam)  # -> Area, Centroid
cos = Cosine(Value=rad)
evalsrf = EvaluateSurface(Surface=dam, Point=area.Centroid)  # -> Point, Normal, UDirection, VDirection, Frame
devec = DeconstructVector(Vector=evalsrf.Normal)  # -> XComponent, YComponent, ZComponent
graft = GraftTree(Tree=evalsrf.Normal, IncludeEmptyLists=True, IncludeNullItems=True)
graft_2 = GraftTree(Tree=dam, IncludeEmptyLists=True, IncludeNullItems=True)

# ---- group: 微小な数値を丸める
multiplication = Multiplication(A=devec.ZComponent, B="1000")
round = Round(Number=multiplication)  # -> Nearest, Floor, Ceiling
division = Division(A=round.Floor, B="1000")

# ----
line = LineSDL(Start=area.Centroid, Direction=evalsrf.Normal, Length=Slider(6576, range=0..10000))

smaller = SmallerThan(FirstNumber=division, SecondNumber=cos)  # -> SmallerThan, OrEqualTo
larger = LargerThan(FirstNumber=division, SecondNumber=cos)  # -> LargerThan, OrEqualTo
equals = Equality(FirstNumber=division, SecondNumber="1")  # -> Equality, Inequality
and = GateAnd(A=larger.LargerThan, B=equals.Inequality)
graft_3 = GraftTree(Tree=and, IncludeEmptyLists=True, IncludeNullItems=True)
cull = CullPattern(List=graft, CullPattern=graft_3)
cull_2 = CullPattern(List=join, CullPattern=graft_3)

# ---- group: 受持ち屋根のSurface
cull_3 = CullPattern(List=dam, CullPattern=equals.Equality)

# ---- group: 雨に当たらないSurface
cull_4 = CullPattern(List=dam, CullPattern=smaller.OrEqualTo)

# ---- group: 勾配屋根のSurface
cull_5 = CullPattern(List=graft_2, CullPattern=graft_3)

# ----
amp = Amplitude(Vector=cull, Amplitude="1000")
extr = Extrude(Base=cull_2, Direction=amp)

# ---- group: 勾配屋根の法線方向
vec = Vector(simplify(cull))

# ---- group: 勾配屋根のSurface
srf_2 = Surface(simplify(cull_5))

# ---- group: 降下地点を特定するための障壁(勾配屋根と同じリスト構造になっている)
brep = Brep(simplify(extr))

# ---- group: 受持ち屋根のSurface
srf_3 = Surface(cull_3)

# ---- group: 雨に当たらないSurface
srf_4 = Surface(cull_4)

# ----
mesh = MeshBrep(Brep=srf_2, Settings=custom_mesh_settings)
faceb = FaceBoundaries(Mesh=mesh)

# ---- group: このメモは消さない。この中心点は使わないこと(Surfaceの法線方向となぜか逆転する現象が見受けられるため)
facen = FaceNormals(Mesh=mesh)  # -> Centers, Normals; disabled
pt = Point(facen.Normals)  # disabled

# ----
boundary = BoundarySurfaces(Edges=faceb)  # -> simplify(Surfaces)
area_2 = Area(Geometry=boundary)  # -> Area, Centroid
graft_4 = GraftTree(Tree=vec, IncludeEmptyLists=True, IncludeNullItems=True)
lng = ListLength(List=area_2.Centroid)

# ---- group: 各Faceの法線方向
repeat = RepeatData(Data=graft_4, Length=lng)  # -> simplify(Data)

# ---- group: 法線方向の確認用
amp_2 = Amplitude(Vector=repeat, Amplitude=Slider(5000, range=0..10000))

# ---- group: 各Faceの中心点
pt_2 = Point(area_2.Centroid)

# ----
dam_2 = DataDam(DataA=repeat, BufferDelay=10000000, BufferMode=0)

# ---- group: 雨が当たる場所のみTrueを返す
py3 = Python3Script(vecs=dam_2, pts=pt_2, breps=dam)  # -> ok_line_tree, judge_tree; inputs vecs: tree of Vector3d, pts: tree of Point3d, breps: list of Brep
# ---------- py3: Python ----------
import System
from Grasshopper import DataTree
from Grasshopper.Kernel.Data import GH_Path

import Rhino.Geometry as rg
import math
import ghpythonlib.components as ghcomp



#Lineを入力してVectorに変換する関数(現在使わない。)
def vector2pt(line):
    st_pt = line.PointAtStart
    end_pt = line.PointAtEnd
    vec = rg.Vector3d(end_pt - st_pt)
    return vec

#各分割数を指定して、centerからの各雨水の角度(Line)のリストを返す関数
def rain_angle_list(center, angle_in=30, n1=5, n2=10):#n1：雨の入射角に対する分割数　n2：平面（360°）に対する分割数
    #centerからZ方向のLineを生成する
    to_pt = rg.Point3d(center.X, center.Y, center.Z + 100000)
    linecurve = rg.LineCurve(rg.Line(center, to_pt))

    axis1 = rg.Vector3d(1, 0, 0)
    axis2 = rg.Vector3d(0, 0, 1)
    rotated_geo = linecurve
    
    line_list = [linecurve]
    #Frontから見た角度
    for k in range(n1):
        angle1 = math.radians(angle_in / n1)
        rotation1 = rg.Transform.Rotation(angle1, axis1, center)
        rotated_geo = rotated_geo.Duplicate()
        rotated_geo.Transform(rotation1)
        #平面から見た角度
        for i in range(n2):
            angle2 = math.radians(360 / n2)
            rotation2 = rg.Transform.Rotation(angle2, axis2, center)
            rotated_geo = rotated_geo.Duplicate()
            rotated_geo.Transform(rotation2)
            line_list.append(rotated_geo)
    return line_list

#雨水と物体(breps)の干渉check
#雨水が当たる場合はTrue、1つでもあたらない場合はFalse
def interference_check(lines, breps):
    judge = False
    ok_line = None
    for line in lines:
        result = ghcomp.IsoVistRay(line, 1000000, breps)
        if result[2] == -1:
            judge = True
            ok_line = line
            break
    return judge, ok_line

#PointをVector方向へ指定の長さ分ずらす
def move_point(point, vector, length=1):
    re_point = point
    rg.Vector3d.Unitize(vector)
    normal = vector * length
    transform = rg.Transform.Translation(normal)
    rg.Point3d.Transform(re_point, transform)
    return re_point






#多次元リスト(データツリー)にするためにデータツリーのリストを作る
judge_tree = DataTree[System.Object]()
ok_line_tree = DataTree[System.Object]()
num = 0

for path in vecs.Paths:
    vec_list = vecs.Branch(path)
    pt_list = pts.Branch(path)
    judge_list = []
    ok_line_list = []
    
    for i, vec in enumerate(vec_list):
        pt = pt_list[i]
        pt = move_point(pt, vec)
        lines = rain_angle_list(pt)
        judge, ok_line = interference_check(lines, breps)
        judge_list.append(judge)
        ok_line_list.append(ok_line)

    #データツリーの操作
    judge_tree.AddRange(judge_list, path)
    ok_line_tree.AddRange(ok_line_list, path)
# ---------- end py3 ----------

# ---- group: 各Faceの法線方向
cull_6 = CullPattern(List=dam_2, CullPattern=py3.judge_tree)

# ---- group: 雨が当たるSurface
cull_7 = CullPattern(List=boundary, CullPattern=py3.judge_tree)

# ----
py3_2 = Python3Script(charge_roof=srf_3, slope_roof_tree=cull_7, barrier_tree=brep, normal_tree=cull_6)  # -> roof_id_list, landingSurface_list, roof_type_list, area_list, centroid_list, descent_pt_list; inputs charge_roof: list of Brep, slope_roof_tree: tree of Brep, barrier_tree: tree of Brep, normal_tree: tree of Vector3d
#   port charge_roof: 説明： 受持ち屋根 注意： Type HintsはBrepにしている。 これはTrimmed SurfaceがUntrimmed Surfaceと認識されてしまうため。
#   port slope_roof_tree: 説明： 勾配屋根 注意： Type HintsはBrepにしている。 これはTrimmed SurfaceがUntrimmed Surfaceと認識されてしまうため。
#   port normal_tree: 説明： Faceの法線方向 補足： Python上でFaceの法線方向の取得を試みたが、元となるsurfaceの法線方向とFaceの法線方向が異なる現象が確認された為Faceを入力する
#   port area_list: 説明： 各slope_roofがどのcharge_roofに落ちるか、charge_roofのインデックスを返す。 リスト構造： slope_roofと同じリスト構造
#   port descent_pt_list: 説明： 最終的に受持ち屋根に落ちる雨水の面積 リスト構造： charge_roofと同じリスト構造
# ---------- py3_2: Python ----------
import System
from Grasshopper import DataTree
from Grasshopper.Kernel.Data import GH_Path

import Rhino.Geometry as rg
import scriptcontext as sc
import math
import uuid
import itertools as it

import ghpythonlib.components as ghcomp



#PointをVector方向へ指定の長さ分ずらす
def move_point(point, vector, length=1):
    re_point = point
    rg.Vector3d.Unitize(vector)
    normal = vector * length
    transform = rg.Transform.Translation(normal)
    rg.Point3d.Transform(re_point, transform)
    return re_point

#法線方向から面を流れる方向を求める関数
def FlowVector(normal_vec):
    if normal_vec[2] == 0:
        z = -1
    else:
        z = -1 * ((normal_vec[0]**2 + normal_vec[1]**2)**(1/2))
    k = (-1) * ((normal_vec[2] * z) / (normal_vec[0]**2 + normal_vec[1]**2))
    x = normal_vec[0] * k
    y = normal_vec[1] * k
    flow_vec = rg.Vector3d(x, y, z)
    return flow_vec

#屋根面を伝って、降下するpointを返す関数
def descent_point(breps, start_point, normal_vec):#(勾配屋根のエッジの面, メッシュの中心, メッシュの面の法線方向)
    re_start_point = move_point(start_point, normal_vec, 5)
    re_start_point = [re_start_point]
    direction = FlowVector(normal_vec)
    tolerance = 0.1
    Point, geo_index =  ghcomp.ProjectPoint(re_start_point, direction, breps)

    return Point

#Brepは単一のFaceであること
def surface_from_brep(brep):
    face = brep.Faces
    brepface = face[0]

    amp = rg.AreaMassProperties.Compute(brepface)
    #中心点
    centroid = amp.Centroid
    #面積
    area = amp.Area

    #法線方向
    u_domain = brepface.Domain(0)  # U方向の範囲
    v_domain = brepface.Domain(1)  # V方向の範囲
    # 中央の (u, v) を計算
    u_mid = u_domain.Mid  # U範囲の中心
    v_mid = v_domain.Mid  # V範囲の中心
    # サーフェスの中心座標
    normal = brepface.NormalAt(u_mid, v_mid)
    surface = brepface
    return surface, centroid, area

#地面に対して法線方向に向いた面の角度を求める
def get_surface_angle(normal):
    # 基準となるZ軸ベクトル
    z_axis = rg.Vector3d(0, 0, 1)

    # 法線ベクトルの長さ（正規化されていない場合に備えて）
    normal.Unitize()

    # 内積を計算
    dot_product = normal * z_axis

    # 角度を求める（ラジアン → 度に変換）
    angle_rad = math.acos(dot_product)
    angle_deg = math.degrees(angle_rad)

    return angle_deg


#勾配屋根の辞書リストを作成
slope_dic_list = []
for path in slope_roof_tree.Paths:
    brep_list = list(slope_roof_tree.Branch(path))
    normal_list = normal_tree.Branch(path)

    #障壁を取得する
    gh_path = path.Indices
    index = gh_path[0]
    barriers = barrier_tree.Branch(path)
    
    #Surfes全体に雨が当たらない階層がある場合スキップする
    if len(brep_list) == 0:
        continue


    #確認用
    descent_pt_list = []
    locus_list = []


    for i, brep in enumerate(brep_list):
        normal = normal_list[i]
        #Surfaceの中心点、法線方向、面積を取得する
        surface, centroid, area = surface_from_brep(brep)
                
        #centroidを障壁に当て、降下地点を取得する
        descent_pt = descent_point(barriers, centroid, normal)
        #descent_ptのままだと受持ち屋根のsurfaceに当たらない現象が確認された為、Z座標を切り上げする
        descent_pt = rg.Point3d(descent_pt.X, descent_pt.Y, math.ceil(descent_pt.Z))
        
        #面積に掛ける角度の係数を求める
        degree = get_surface_angle(normal)
        if degree > 30:
            k = math.sin(math.radians(120 - degree))
        else:
            k = 1


        slope_dic = {}
        slope_dic["roof_id"] = uuid.uuid4()
        slope_dic["surface"] = surface
        slope_dic["area"] = area * k #面積
        slope_dic["centroid"] = centroid #中心点
        slope_dic["roof_type"] = 1 #0:受持ち屋根 1:勾配屋根
        slope_dic["descent_pt"] = descent_pt #降下地点
        slope_dic_list.append(slope_dic)




#受持ち屋根の辞書リストを作成
charge_dic_list = []
for charge_surface in charge_roof:
    charge_amp = rg.AreaMassProperties.Compute(charge_surface)
    charge_area = charge_amp.Area

    charge_dic = {}
    charge_dic["roof_id"] = uuid.uuid4()
    charge_dic["surface"] = charge_surface
    charge_dic["area"] = charge_area #面積
    charge_dic["centroid"] = None #中心点
    charge_dic["roof_type"] = 0 #0:受持ち屋根 1:勾配屋根
    charge_dic["descent_pt"] = None #降下地点
    charge_dic_list.append(charge_dic)

#受持ち屋根と勾配屋根の辞書リストを結合する
landing_dic_list = charge_dic_list + slope_dic_list

roof_id_list = []
landingSurface_list = []
roof_type_list = []
area_list = []
centroid_list = []
descent_pt_list = []
for dic in landing_dic_list:
    roof_id_list.append(dic["roof_id"])
    landingSurface_list.append(dic["surface"])
    roof_type_list.append(dic["roof_type"])
    area_list.append(dic["area"])
    centroid_list.append(dic["centroid"])
    descent_pt_list.append(dic["descent_pt"])
# ---------- end py3_2 ----------
graft_5 = GraftTree(Tree=py3_2.descent_pt_list, IncludeEmptyLists=True, IncludeNullItems=True)
project = ProjectPoint(Point=graft_5, Direction=rev, Geometry=py3_2.landingSurface_list)  # -> Point, Index
flatten = FlattenTree(Tree=project.Index, Path="{0}")

# ---- group: 0：受け持ち屋根・1：勾配屋根
equals_2 = Equality(FirstNumber=py3_2.roof_type_list, SecondNumber="1")  # -> Equality, Inequality

# ----
cull_8 = CullPattern(List=py3_2.landingSurface_list, CullPattern=equals_2.Inequality)

# ---- group: 「-1」は、最後の受持ち屋根に認識されてしまうため、「-1」をnullに変換する
int = Integer("-1")
mindex = MemberIndex(Set=flatten, Member=int)  # -> Index, Count
py3_3 = Python3Script()  # -> a
# ---------- py3_3: Python ----------
a = None
# ---------- end py3_3 ----------
replace = ReplaceItems(List=flatten, Item=py3_3, Indices=mindex.Index, Wrap=False)

# ----
merge = Merge(Data1=graft(py3_2.centroid_list), Data2=graft(py3_2.centroid_list), Data3=project.Point)
item = ListItem(List=py3_2.roof_id_list, Index=replace, Wrap=True)
cull_9 = CullPattern(List=py3_2.roof_id_list, CullPattern=equals_2.Equality)
cull_10 = CullPattern(List=py3_2.area_list, CullPattern=equals_2.Inequality)
cull_11 = CullPattern(List=py3_2.area_list, CullPattern=equals_2.Equality)
cull_12 = CullPattern(List=py3_2.roof_id_list, CullPattern=equals_2.Inequality)
cull_13 = CullPattern(List=py3_2.roof_id_list, CullPattern=equals_2.Equality)
cull_14 = CullPattern(List=item, CullPattern=equals_2.Equality)

bbox = BoundingBox(Content=srf, Plane=PlaneXY(0, 0, 0), UnionBox=True)  # -> Box, Box_2
volume = Volume(Geometry=bbox.Box)  # -> Volume, Centroid
scale = Scale(Geometry=bbox.Box, Center=volume.Centroid, Factor="1.25")  # -> Geometry, Transform
debrep = DeconstructBrep(Brep=scale.Geometry)  # -> Faces, Edges, Vertices
area_3 = Area(Geometry=debrep.Faces)  # -> Area, Centroid
pdecon = Deconstruct(Point=area_3.Centroid)  # -> XComponent, YComponent, ZComponent
sort = SortList(Keys=pdecon.ZComponent, ValuesA=debrep.Faces)  # -> Keys, ValuesA
cull_15 = CullPattern(List=py3_2.landingSurface_list, CullPattern=equals_2.Inequality)
area_4 = Area(Geometry=cull_15)  # -> Area, Centroid
merge_2 = Merge(Data1="0", Data2="-1")
cull_i = CullIndex(List=sort.ValuesA, Indices=merge_2, Wrap=True)
join_2 = BrepJoin(Breps=cull_i)  # -> Breps, Closed
brep_cp = BrepClosestPoint(Point=area_4.Centroid, Brep=join_2.Breps)  # -> Point, Normal, Distance
ln = Line(StartPoint=area_4.Centroid, EndPoint=brep_cp.Point)

py3_4 = Python3Script(
    slope_roof_id_list=cull_13,
    slope_area_list=cull_11,
    charge_roof_id_list=cull_12,
    charge_area_list=cull_10,
    from_id_list=cull_9,
    to_id_list=cull_14)  # -> goal_roof_id_list, total_area_list; inputs slope_roof_id_list: list, slope_area_list: list of Double, charge_roof_id_list: list, charge_area_list: list, from_id_list: list, to_id_list: list
#   port from_id_list: 説明： 隣接関係のスタート
#   port goal_roof_id_list: 説明： slope_roof_idの順番にcharge_roof_id_listの値を返す
#   port total_area_list: 説明： charge_roof_id_listの順番に各受持ち屋根に落ちる面積の合計(㎥)を返す
# ---------- py3_4: Python ----------
import itertools as it

#勾配屋根がどの受持ち屋根に到達するかを判定する関数
def RainFlow_judge(adjacency, slope_roof, slope_roof_area, take_roof, take_roof_area):
    #どの屋根にも落ちない屋根を追加する
    take_roof = take_roof + [-1]
    takeroof_total_area = take_roof_area + [0]

    search_take_roof_list = [[i] for i in take_roof]

    while len(adjacency) > 0:
        pop_list = []
        judge = len(adjacency)
        for num1, val1 in enumerate(adjacency):
            target = val1[1]
            adjacent = val1[0]
            print(adjacent)
            for num2, val2 in enumerate(search_take_roof_list):
                if target in val2:
                    search_take_roof_list[num2].append(adjacent)
                    pop_list.append(num1)
                    a = slope_roof.index(adjacent)
                    area = slope_roof_area[a]
                    takeroof_total_area[num2] += area
                    break
        for j in sorted(pop_list, reverse=True):
            adjacency.pop(j)    
        if len(adjacency) == judge:
            break
    loop_list = tuple(it.chain.from_iterable(adjacency))
    
    goalroof_list = []
    for val3 in slope_roof:
        cou = 0
        for num4, val4 in enumerate(search_take_roof_list):
            if val3 in val4:
                take_roof_indexl = take_roof[num4]
                goalroof_list.append(take_roof_indexl)
                break
            elif val3 in loop_list:
                goalroof_list.append(None)
                break
            else:
                cou += 1
    missing_total_area = takeroof_total_area[-1]
    takeroof_total_area.pop(-1)
    return goalroof_list, takeroof_total_area, missing_total_area

adjacency = []
for from_id, to_id in zip(from_id_list, to_id_list):
    adjacent = [from_id, to_id]
    adjacency.append(adjacent)
    print(adjacent)

goal_roof_id_list, total_area_list, missing_total_area = RainFlow_judge(adjacency, slope_roof_id_list, slope_area_list, charge_roof_id_list, charge_area_list)
# ---------- end py3_4 ----------
py3_5 = Python3Script(
    roof_id_list=py3_2.roof_id_list,
    slope_roof_id_list=cull_13,
    goal_roof_id_list=py3_4.goal_roof_id_list,
    charge_roof_id_list=cull_12)  # -> roof_color_list; inputs roof_id_list: list, slope_roof_id_list: list, goal_roof_id_list: list, charge_roof_id_list: list
# ---------- py3_5: Python ----------
import ghpythonlib.components as ghcomp

#色の設定
dic = {}
for num, charge_roof_id in enumerate(charge_roof_id_list):
    h = num / len(charge_roof_id_list)
    takeroof_color = ghcomp.ColourHSV(1, h, 1, 1)
    dic[charge_roof_id] = takeroof_color


#行方不明の色の設定
missing_color = ghcomp.ColourHSV(1, 0, 0, 0)

for slope_roof_id, goal_roof_id in zip(slope_roof_id_list, goal_roof_id_list):
    if goal_roof_id == None:
        color = missing_color
    else:
        color = dic[goal_roof_id]
    dic[slope_roof_id] = color


#案2
roof_color_list = []
for roof_id in roof_id_list:
    color = dic[roof_id]
    roof_color_list.append(color)
# ---------- end py3_5 ----------

# ---- group: ㎥に変換する
sqr = Square(Value="1000")
division_2 = Division(A=py3_4.total_area_list, B=sqr)

# ----
panel = Panel(division_2)
py3_6 = Python3Script(w=降水量, roof_id_list=cull_12, total_roof_area_list=panel)  # -> a, b, inf; inputs w: Double, roof_id_list: list, total_roof_area_list: list of Double
# ---------- py3_6: Python ----------
import math
import pprint

import System
from Grasshopper import DataTree
from Grasshopper.Kernel.Data import GH_Path

brief_leak_dic = {"A100": 90, "A125": 170, "A150": 270, "A200": 575} #横走り管勾配1/100の場合
#brief_leak_dic = {"A100": 130, "A125": 240, "A150": 380, "A200": None} #横走り管勾配1/50の場合
#brief_leak_dic = {"A100": 230, "A125": 440, "A150": 690, "A200": 1500} #縦管の場合

pipe_list = ["A100", "A125", "A150", "A200"]



class RdCount:
    def __init__(self, roof_id, total_roof_area):
        self.roof_id = roof_id
        self.total_roof_area = total_roof_area
    #受持ち面積に対するドレンの数を求める
    def rd_count(self):
        self.rd_count_dic = {} #各管径の必要個数の辞書
        for pipe in pipe_list:
            if pipe == None:
                    continue
            else:
                if w <= 30:
                    receiving_roofarea = brief_leak_dic[pipe]
                elif w > 30:
                    receiving_roofarea = brief_leak_dic[pipe] * (30 / w)
            rd_count = math.ceil(self.total_roof_area / receiving_roofarea)#切り上げした個数
            self.rd_count_dic[pipe] = rd_count
        return self.rd_count_dic
    
    #ドレンの数の表示
    def rd_count_display(self):
        rd_inf = ["屋根ID: " + str(roof_id),
                    "合計の受持ち面積(㎡): " + str(total_roof_area),
                    "A100: " + str(self.rd_count_dic[pipe_list[0]]) + " + 1個",
                    "A125: " + str(self.rd_count_dic[pipe_list[1]]) + " + 1個",
                    "A150: " + str(self.rd_count_dic[pipe_list[2]]) + " + 1個",
                    "A200: " + str(self.rd_count_dic[pipe_list[3]]) + " + 1個",]
        return rd_inf

inf = DataTree[System.Object]()
a = []
b = []
path_num = 0

for (roof_id, total_roof_area) in zip(roof_id_list, total_roof_area_list):
    rdcount = RdCount(roof_id, total_roof_area)
    a.append(rdcount.rd_count())
    b.append(rdcount.rd_count_display())
    
    path = GH_Path(path_num)
    inf.AddRange(rdcount.rd_count_display(), path)
    print(path)
    path_num += 1
# ---------- end py3_6 ----------

# ---- group: 文字を表示するPlaneを作成する。
vec_2 = Vector(ln)
Z_2 = UnitZ(Factor=1)
rev_2 = Reverse(Vector=vec_2)
vrot = Rotate(Vector=rev_2, Axis=Z_2, Angle=degrees("-90"))
pl = ConstructPlane(Origin=brep_cp.Point, XAxis=vrot, YAxis=rev_2)

# ---- group: 文字を表示する
文字の大きさ = Panel("500")
multiplication_2 = Multiplication(A=文字の大きさ, B="1.5")
lng_2 = ListLength(List=py3_6.inf)
vec_3 = Vector(ln)
series = Series(Start=0, Step=multiplication_2, Count=lng_2)
graft_6 = GraftTree(Tree=vec_3, IncludeEmptyLists=True, IncludeNullItems=True)
amp_3 = Amplitude(Vector=graft_6, Amplitude=series)
graft_7 = GraftTree(Tree=pl, IncludeEmptyLists=True, IncludeNullItems=True)
move = Move(Geometry=graft_7, Motion=amp_3)  # -> simplify(Geometry), Transform

# ---- group: 雨の軌跡
pline = PolyLine(Vertices=merge, Closed=False)  # -> flatten(Polyline)

# ---- group: 法線方向の表示
vdis = VectorDisplay(Anchor=pt_2, Vector=amp_2)

# ---- group: 受け持ち屋根の色分け
preview = CustomPreview(Geometry=py3_2.landingSurface_list, Material=py3_5)

# ---- group: ドレン個数表示の引出し線
line_2 = Line(ln)

# ---- group: ドレン個数表示
tag = TextTag3D(Location=move.Geometry, Text=py3_6.inf, Size=文字の大きさ, Justification=7)
