# Grasshopper definition 面に沿って落ちる関数.gh (Grasshopper 1.0.7)

custom_mesh_settings = SettingsCustom(
    StitchSeams=True,
    SimplePlanes=False,
    Refine=True,
    MinCount=16,
    MaxCount=400,
    AspectRatio=20,
    MaxDistance=0,
    MaxAngle=20,
    MinEdge=0,
    MaxEdge=0)
srf = Surface(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)
srf_2 = Surface([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])
mesh = MeshBrep(Brep=srf, Settings=custom_mesh_settings)
python = GhPythonScript(roof=srf, mesh=mesh)  # -> centroid, normal_vec_list, drop_point_list; inputs roof: Brep, mesh: Mesh
# ---------- python: Python ----------
import rhinoscriptsyntax as rs
import Rhino.Geometry as rg


#法線方向から面を流れる方向を求める関数
def FlowVector(normal_vec):
    x = normal_vec[0]
    y = normal_vec[1]
    if normal_vec[2] == 0:
        z = -1
    else:
        z = -(x**2 + y**2) / normal_vec[2]
    flow_vec = rg.Vector3d(x, y, z)
    return flow_vec


#重心を求める
mfl = mesh.Faces
centroid = []
for i in range(len(mfl)):
    center = rg.Collections.MeshFaceList.GetFaceCenter(mfl, i)
    centroid.append(center)


#屋根のエッジに光線を衝突させるための障壁を生成
edge_barrier = []
roof_edge = roof.Edges
for i in roof_edge:
    ans = rg.Surface.CreateExtrusion(i, rg.Vector3d(0, 0, 1))
    edge_barrier.append(ans)


#各重心の雨の降下地点を求める
drop_point_list = []
normal_vec_list = rs.MeshFaceNormals(mesh)
for num, normal_vec in enumerate(normal_vec_list):
    flow_vec = FlowVector(normal_vec)
    position = centroid[num]
    ray = rg.Ray3d(position, flow_vec)
    drop_point = rg.Intersect.Intersection.RayShoot(ray, edge_barrier, 1)
    drop_point_list.append(drop_point[0])
    print(drop_point)
# ---------- end python ----------
ln = Line(StartPoint=python.centroid, EndPoint=python.drop_point_list)
pt = Point(python.drop_point_list)
panel = Panel(python.drop_point_list)
panel_2 = Panel(python.centroid)
